# Grasshopper definition solar_path_main.gh (Grasshopper 1.0.7)

minutes = Slider(12, range=0..60)
degrees = Slider(0, range=0..89)
division = Division(A=minutes, B=60)
series = Series(Start=-90, Step=15, Count=13)
addition = Addition(A=degrees, B=division)
list = ValueList({"Equinox": 0, "Summer Solstice": 23.45, "Winter Solstice": -23.45}, selected="Equinox")
rad = Radians(Degrees=series)
rad_2 = Radians(Degrees=addition)
rad_3 = Radians(Degrees=list)
panel = Panel(addition)
c_script = CSharpScript(r=Slider(100, range=0..100), HRA=rad, LAT=rad_2, DEC=rad_3)  # -> out, rs, ds, rsr; inputs r: Double, HRA: Double, LAT: Double, DEC: Double
# ---------- c_script: C# ----------
    double ALT = (Math.Asin((Math.Sin(DEC) * Math.Sin(LAT)) + (Math.Cos(DEC) * Math.Cos(LAT) * Math.Cos(HRA))));

    List<double> ALT_list = new List<double>();
    ALT_list.Add(ALT);

    List<double> ALT_list_corrected = new List<double>();

    foreach (double i in ALT_list){
      ALT_list_corrected.Add(i * 1);

    }

/*
    foreach (int i in ALT_list){
      if (i < 6) {
        Console.WriteLine(ALT_list_corrected[i]);
      }}
 */

    rs = r * Math.Cos(DEC) / (Math.Sin(ALT) + Math.Sin(DEC));
    ds = r * Math.Cos(LAT) / (Math.Sin(LAT) + Math.Sin(DEC));
    rsr = ALT_list_corrected[0];
# ---------- end c_script ----------
c_script_2 = CSharpScript(x=Slider(90, range=0..100))  # -> out, A; inputs x: Double
# ---------- c_script_2: C# ----------
    if (x < 10){
      A = x;
    }
# ---------- end c_script_2 ----------
arc = Arc(Plane=PlaneXY(0, 0, 0), Radius=c_script.ds, Angle=Domain(0, 3.141592654))  # -> Arc, Length
deg = Degrees(Radians=c_script.rsr)
cos = Cosine(Value=3.14159)
series_2 = Series(Start=0, Step=1, Count=25)
split = SplitList(List=deg, Index=6)  # -> ListA, ListB
neg = Negative(Value=split.ListA)
cset = CreateSet(List=[neg, split.ListB])  # -> Set, Map
pt = ConstructPoint(XCoordinate=flatten(series_2), YCoordinate=flatten(cset.Set), ZCoordinate=0)
panel_2 = Panel(cset.Set)
